# Grasshopper definition 0_end.gh (Grasshopper 1.0.7)
# plug-ins: Human

number_slider = Slider(12, range=0..20)
number_slider_2 = Slider(14, range=0..20)
pt = Point(<point referenced from the Rhino model>)
ellipse = Ellipse(Plane=pt, Radius1=Slider(20, range=0..50), Radius2=Slider(30, range=0..50))  # -> Ellipse, Focus1, Focus2
series = Series(Start=0, Step=number_slider, Count=number_slider_2)
series_2 = Series(Start=0, Step=Slider(30, range=0..30), Count=number_slider_2)
Z = UnitZ(Factor=series)
move = Move(Geometry=ellipse.Ellipse, Motion=Z)  # -> Geometry, Transform
rad = Radians(Degrees=series_2)
rotate = Rotate(Geometry=move.Geometry, Angle=rad, Plane=PlaneXY(0, 0, 0))  # -> Geometry, Transform
Z_2 = UnitZ(Factor=number_slider)
extr = Extrude(Base=rotate.Geometry, Direction=Z_2)
len = Length(Curve=rotate.Geometry)
cap = CapHoles(Brep=extr)
division = Division(A=len, B=Slider(10, range=5..20))
round = Round(Number=division)  # -> Nearest, Floor, Ceiling
divide = DivideCurve(Curve=rotate.Geometry, Count=round.Nearest, Kinks=False)  # -> Points, Tangents, Parameters
move_2 = Move(Geometry=divide.Points, Motion=Z_2)  # -> Geometry, Transform
shift = ShiftList(List=divide.Points, Shift=1, Wrap=True)
shift_2 = ShiftList(List=move_2.Geometry, Shift=1, Wrap=True)
pline = PolyLine(Vertices=move_2.Geometry, Closed=True)
pline_2 = PolyLine(Vertices=divide.Points, Closed=True)
boundary = BoundarySurfaces(Edges=pline)
boundary_2 = BoundarySurfaces(Edges=pline_2)
srf4pt = _4PointSurface(CornerA=divide.Points, CornerB=shift, CornerC=shift_2, CornerD=move_2.Geometry)  # -> simplify(Surface)
area = Area(Geometry=srf4pt)  # -> Area, Centroid
brep_cp = BrepClosestPoint(Point=area.Centroid, Brep=srf4pt)  # -> Point, Normal, Distance

amp = Amplitude(Vector=brep_cp.Normal, Amplitude=Slider(5, range=1..5))
vdisex = VectorDisplayEx(Point=brep_cp.Point, Vector=amp, Colour=RGB(0, 0, 0), Width=2)

amp_2 = Amplitude(Vector=brep_cp.Normal, Amplitude=Slider(1, range=1..5))
scale = Scale(Geometry=srf4pt, Center=area.Centroid, Factor=Slider(0.73, range=0..1))  # -> Geometry, Transform
move_3 = Move(Geometry=scale.Geometry, Motion=amp_2)  # -> Geometry, Transform
edges = BrepEdges(Brep=srf4pt)  # -> Naked, Interior, NonManifold
edges_2 = BrepEdges(Brep=move_3.Geometry)  # -> Naked, Interior, NonManifold

previewlw = CustomPreviewLineweights(
    Geometry=edges_2.Naked,
    Shader=ColourSwatch(SwatchColor=RGB(0, 0, 0)),
    Thickness=Slider(4.52, range=0..10),
    Absolute=False)

join = JoinCurves(Curves=edges.Naked, Preserve=False)
join_2 = JoinCurves(Curves=edges_2.Naked, Preserve=False)
merge = Merge(Data1=join, Data2=join_2)
loft = Loft(Curves=merge, Options={Adjust=False, Closed=False, LoftEnds=0, LoftSimp=0, LoftType=0, Rebuild=10, Refit=0.01})  # -> simplify(Loft)
graft = GraftTree(Tree=move_3.Geometry, IncludeEmptyLists=True, IncludeNullItems=True)
merge_2 = Merge(Data1=loft, Data2=graft)
join_3 = BrepJoin(Breps=merge_2)  # -> Breps, Closed
path_mapper = PathMapper(join_3.Breps, source="{A;B}", target="{A}")

merge_3 = Merge(Data1=path_mapper, Data2=simplify(boundary_2), Data3=simplify(boundary))
join_4 = BrepJoin(Breps=merge_3)  # -> flatten(Breps), Closed
lng = ListLength(List=join_4.Breps)
range = Range(Domain=Domain(0, 1), Steps=lng)
gradient = Gradient(LowerLimit=0, UpperLimit=1, Parameter=range, stops=[0: RGB(179, 130, 194), 1: RGB(126, 198, 222)])
argb = SplitARGB(Colour=gradient, IntegerChannels=True)  # -> Alpha, Red, Green, Blue
rgb = ColourRGB(Alpha=Slider(215, range=0..1000), Red=argb.Red, Green=argb.Green, Blue=argb.Blue)
preview = CustomPreview(Geometry=join_4.Breps, Material=rgb)
