# Grasshopper definition 1_challenge.gh (Grasshopper 1.0.7)

pipeline = GeometryPipeline(
    GroupByLayer=False,
    GroupByType=False,
    IncludeHidden=True,
    IncludeLocked=True,
    LayerFilter="Default",
    NameFilter="*",
    SublayerFiltering=True,
    TypeFilter=1073741848)
python = GhPythonScript(srf=pipeline, u_num=Slider(7, range=2..10), v_num=Slider(8, range=2..10))  # -> out, pts; inputs srf: Surface, u_num: Int32
# ---------- python: Python ----------
import Rhino.Geometry as rh


#print srf

print rh.PlaneSurface.IsValid
print srf.IsValid

d_1 = srf.Domain(0)

u_min = d_1.Min
u_max = d_1.Max

print u_min, u_max

d_2 = srf.Domain(1)

v_min = d_2.Min
v_max = d_2.Max

print v_min, v_max


print type(srf)


a = srf.PointAt(5, 5)

pts = []

u_inc = u_max / (u_num - 1)
v_inc = v_max / (v_num - 1)

print u_inc, v_inc

for u in range(u_num): # [0, 1, 2, ... 9]
    
    pts.append([])
    
    for v in range(int(v_num)):
        
        # first I make the point
        pt = srf.PointAt(u * u_inc, v * v_inc)
        
        inner_list = pts[-1]
        
        # then I add it to a list
        inner_list.append(pt)

print pts[1][1]
# ---------- end python ----------
points = PointList(Points=python.pts, Size=Slider(0.2, range=0..10))
ghpython_script = GhPythonScript(x=python.pts)  # -> out, a
# ---------- ghpython_script: Python ----------
a = x
# ---------- end ghpython_script ----------
panel = Panel(ghpython_script.a)
pipeline_2 = GeometryPipeline(
    GroupByLayer=False,
    GroupByType=False,
    IncludeHidden=True,
    IncludeLocked=True,
    LayerFilter="Default",
    NameFilter="*",
    SublayerFiltering=True,
    TypeFilter=1073741848)
python_2 = GhPythonScript(srf=pipeline_2, u_num=Slider(6, range=0..10), v_num=Slider(8, range=0..20))  # -> out, pts, original, planar, edge; inputs srf: Surface, u_num: Int32, v_num: Int32
# ---------- python_2: Python ----------
import Rhino.Geometry as rh

d_1 = srf.Domain(0)
d_2 = srf.Domain(1)

print(d_1.Min, d_1.Max)
print(d_2.Min, d_2.Max)

u_spacing = (d_1.Max - d_1.Min) / u_num
v_spacing = (d_2.Max - d_2.Min) / v_num

print u_spacing, v_spacing

pts = []

for u in range(u_num + 1):
    pts.append([]) ## for each row, we  first add an empty list
    for v in range(int(v_num + 1)):
        pt = srf.PointAt(u * u_spacing, v * v_spacing)
        pts[-1].append(pt) ## after creating a new point we add it to the last list (representing the current row)

polys = []

for i, row in enumerate(pts[:-1]):
    for j, pt_1 in enumerate(row[:-1]):
        
        polys.append({}) ## add an empty dictionary to the list
        
        pt_2 = row[j+1]
        next_row = pts[i+1]
        pt_3 = next_row[j+1]
        pt_4 = next_row[j]
        
        poly = rh.PolylineCurve([pt_1, pt_2, pt_3, pt_4, pt_1])
        polys[-1]["original"] = poly ## store original poly in the last dictionary with a key
        
        pt_set = [pt_1, pt_2, pt_3, pt_4]
        
        min_dist = float("inf")
        
        for k in range(len(pt_set)):
            
            pl = rh.Plane(pt_set[0], pt_set[1], pt_set[3])
            t = rh.Transform.PlanarProjection(pl)
            
            old_pt = pt_set[2]
            
            new_pt = rh.Point3d(old_pt)
            
            cp = srf.ClosestPoint(new_pt)
            
            n = srf.NormalAt(cp[1], cp[2])
            
            new_pt.Transform(rh.Transform.Translation(n))
            
            l = rh.Line(old_pt, new_pt)
            
            inter = rh.Intersect.Intersection.LinePlane(l, pl)
            
            if inter[0]:
                int_point = l.PointAt(inter[1])
            
            if old_pt.DistanceTo(int_point) < min_dist:
                min_dist = old_pt.DistanceTo(int_point)
                final_pts = [pt_set[0], pt_set[1], int_point, pt_set[3]]
                
                planar_poly = rh.PolylineCurve(final_pts + [final_pts[0]])
                polys[-1]["planar"] = planar_poly ## store planar poly with a different key
                
                polys[-1]["edge"] = []
                if min_dist > 0.01:
                    polys[-1]["edge"].append(rh.PolylineCurve([pt_set[1], int_point, old_pt, pt_set[1]]))
                    polys[-1]["edge"].append(rh.PolylineCurve([pt_set[3], old_pt, int_point, pt_set[3]]))
            
            pt_set = pt_set[1:] + [pt_set[0]]

original = [poly["original"] for poly in polys]
planar = [poly["planar"] for poly in polys]
edge = [poly["edge"] for poly in polys]
# ---------- end python_2 ----------
ghpython_script_2 = GhPythonScript(x=python_2.pts)  # -> out, a; same code as ghpython_script
geo = Geometry(python_2.planar)
ghpython_script_3 = GhPythonScript(x=python_2.edge)  # -> out, a; same code as ghpython_script
geo_2 = Geometry(ghpython_script_2.a)
boundary = BoundarySurfaces(Edges=geo)  # -> simplify(graft(Surfaces))
boundary_2 = BoundarySurfaces(Edges=ghpython_script_3.a)  # -> simplify(Surfaces)
